% Simulink data dictionary tricanter_data.sldd

m0 = repmat(0, 25, 1)
phi0 = repmat(0, 25, 40)
Ts = 1

BusTricOut = Simulink.Bus()  % Шина выходных значений
  cake: Bus: BusCake
  streams: Bus: BusStreams
  quality: Bus: BusQuality
  flags: Bus: BusFlags
  drives: Bus: BusDrives

BusStreams = Simulink.Bus()  % Шина со значениями, связанными с потоками жидкостей
  mdot_oil: double, Unit="kg/s"  % Массовый расход нефтяного продукта (вместе с дисперсной водой)
  mdot_water: double, Unit="kg/s"  % Массовый расход воды
  mdot_cake: double, Unit="kg/s"  % Массовый расход кека
  x_w_in_oil: double  % Обводнённость
  x_o_in_water: double  % Доля нефти в воде
  x_s_in_cake: double  % Доля твёрдой фазы в кеке

use_drives = true
Ts_drv = 0.01

DriveParams = Simulink.Parameter(struct(
  J1=0.004,
  J2=0.0001,
  b1=0.0008,
  Kp1=0.01,
  Ki1=0.01,
  Ki2=0.01,
  Kp2=0.01,
  M1_max=3,
  M2_max=3,
  omega0=0,
  dn0=0), DataType="Bus: BusDriveParams")

BusDriveParams = Simulink.Bus()
  J1: double
  J2: double
  b1: double
  Kp1: double
  Ki1: double
  Ki2: double
  Kp2: double
  M1_max: double
  M2_max: double
  omega0: double
  dn0: double

BusTricGeo = Simulink.Bus()  % Шина с параметрами задачи, вытекающими из входных. Дополняют постановку задачи
  omega: double, Unit="rad/s"  % Угловая частота обращения барабана
  beta: double, Unit="deg"  % Угол подъёма винтовой линии шнека
  Lax: double, Unit="m"  % Осевая длина одной ячейки
  L_cone: double, Unit="m"  % Вклад конуса в осветление в эквивалентных метрах цилиндра (типа эффективное удлиннение)
  f_clar: double  % Множитель осветления с учетом конуса (во сколько раз длина осветления больше чисто цилиндрической. Частично подгоночный)
  u_ax: double, Unit="m/s"  % Она же u_tr. Осевая скорость выноса шнека
  r_i: double, Unit="m"  % Радиус границы раздела нефть-вода из баланса давлений (см. E-line)
  Qo: double, Unit="m^3/s"  % Расход по нефтяному кольцу
  Qw: double, Unit="m^3/s"  % Расход по водяному кольцу
  has_oil: boolean  % Флаг наличия нефтяной фазы
  oil: boolean
  f_so: double
  phi_s0: double
  phi_so0: double
  phi_w0: double

BusCake = Simulink.Bus()  % Шина со значениями, связанными с кеком
  Rtr: double[25], Unit="m"  % Радиус поверхности кека по ячейкам
  dH: double[25], Unit="m"  % Толщина слоя кека по ячейкам
  m_cake: double[25], Unit="kg"  % Масса кека по ячейкам (состояние)
  m_cake_tot: double, Unit="kg"  % Полная масса кека в аппарате
  tau_s: double[25], Unit="s"  % Время пребывания жидкости по ячейкам
  q_cake: double

BusQuality = Simulink.Bus()  % Шина со значениями, фигурирующими в определении качества модели и трикантера в целом
  U: double  % Степень заполнения барабана осадком
  E_s: double  % Эффективность осаждения
  E_w: double  % Эффективность сепарации воды
  phi_s_out: double  % Объёмная доля твёрдого в фугате
  phi_w_out: double  % Обводнённость, объемная
  phi_s_prof: double[25]  % Она же phi_s_i. Профиль концентрации твердого вдоль машины
  phi_w_prof: double[25]  % Она же phi_w_i. Профиль обводнённость нефти вдоль машины
  E_s_i: double[25]  % Доля захвата твёрдого в каждой ячейке
  tau_c: double, Unit="s"  % Суммарное время пребывания жидкости
  E_so: double
  E_s_tot: double
  phi_so_out: double
  bsw: double
  phi_so_prof: double[25]

BusTricParams = Simulink.Bus()  % Шина параметров задачи, которые не меняются со временем
  Rd: double, Unit="m"  % Радиус барабана
  Wsc: double, Unit="m"  % Шаг шнека
  Lpond: double, Unit="m"  % Длина пруда, задает время пребывания и объём
  alpha: double, Unit="deg"  % Полуугол конической части
  Lsep: double, Unit="m"  % Путь осаждения (подгоночный. При учете геометрии конуса ставим 0)
  rho_s: double, Unit="kg/m^3"  % Плотность твердых частиц
  rho_w: double, Unit="kg/m^3"  % Плотность воды
  rho_o: double, Unit="kg/m^3"  % Плотность нефти
  eta_wf: double, Unit="Pa*s"  % Вязкость воды
  mu_s: double  % Коэффициент трения твердых частиц
  phi_sed: double  % Объёмная доля твердого в осадке
  phi_max: double  % Плотная упаковка капель
  phi_ref: double  % Она же phi_gel. Опорная доля для стеснённого осаждения твёрдого
  u_conv: double  % Эффективность конвейирования шнека, отношение фактической скорости транспорта шнека к расчетной (подгоночный)
  bs: double  % Параметр формы распределения частиц
  bw: double  % Параметр формы распределения капель
  rrsb: boolean  % Флаг - распределение RSSB для твёрдой фазы вместо сигмойды (как в Gleiss 2017)
  b_so: double
  rrsb_so: boolean
  inject_at_interface: boolean

TricParams = struct(
  Rd=0.04,
  Wsc=0.025,
  Lpond=0.17,
  alpha=7,
  Lsep=0,
  rho_s=2720,
  rho_w=998,
  rho_o=870,
  eta_wf=0.001,
  mu_s=0.25,
  phi_sed=0.45,
  phi_max=0.64,
  phi_ref=0.13,
  u_conv=0.57,
  bs=3,
  bw=2,
  rrsb=false,
  b_so=3,
  rrsb_so=false,
  inject_at_interface=false)

BusFlags = Simulink.Bus()  % Шина флагов
  bal_resid: double  % Относительная невязка мат. баланса
  M_scroll: double, Unit="N*m"  % Момент сопротивления шнека
  f_oil_collapse: boolean  % Флаг - нефтяное кольцо схлопнулось
  f_water_collapse: boolean  % Флаг - водяное кольцо схлопнулось
  f_overload: boolean  % Флаг - перегруз шнека по подаче
  f_overfill: boolean  % Флаг - переполнение жидкостью
  f_M1_limit: boolean  % Флаг - превышен предельный момент привода барабана
  f_M2_limit: boolean  % Флаг - превышен предельный момент привода шнека
  f_feed_sum: boolean
  f_frac_range: boolean

TricInputs0 = Simulink.Parameter(struct(
  eta_o=0.03,
  d50=3.0e-6,
  x50=1.5e-6,
  eps_s=0.02,
  eps_wd=0.08,
  eps_wf=0.3,
  eps_o=0.6,
  Rw=0.0287,
  Ro=0.028,
  Q=8.333333e-06,
  dn=10,
  C=1500), DataType="Bus: BusTricInputs")

BusDrives = Simulink.Bus()  % Шина со значениями, связанными с расчетом приводов
  M1: double, Unit="N*m"  % Момент барабана
  P1: double, Unit="W"  % Мощность барабана
  M2: double, Unit="N*m"  % Момент шнека
  P2: double, Unit="W"  % Мощность шнека
  J_load: double
  K_pre: double

BusTricInputs = Simulink.Bus()  % Шина входных данных, которые могут меняться с течением времени
  eta_o: double, Unit="Pa*s"  % Вязкость нефти на входе при номинальной температуре
  d50: double, Unit="m"  % Медиана размера капель
  x50: double, Unit="m"  % Медиана размера частиц
  eps_s: double  % Обьемная доля твердых частиц во входном потоке
  eps_wd: double  % Обьемная доля дисперсной воды во входном потоке
  eps_wf: double  % Обьемная доля свободной воды во входном потоке
  eps_o: double  % Обьемная доля нефти во входном потоке
  Rw: double, Unit="m"  % Радиус водяного слива
  Ro: double, Unit="m"  % Радиус нефтяного слива
  Q: double, Unit="m^3/s"  % Входной поток
  dn: double, Unit="rpm"  % Дифференциальная скорость
  C: double  % Центрифужное число
  x50_so: double
  frac_s_in_oil: double
  T_in: double

use_thermals = Simulink.Parameter(false, DataType="boolean")
ConvFormFactor = Simulink.Parameter(-1)